# Grasshopper definition mo.gh (Grasshopper 0.9.76)

srf = Surface([<surface referenced from the Rhino model> x51])
debrep = DeconstructBrep(Brep=srf)  # -> Faces, Edges, Vertices
pt = Point(debrep.Vertices)
vec2pt = Vector2Pt(PointA="{0,0,0}", PointB=pt, Unitize=False)  # -> Vector, Length
amp = Amplitude(Vector=vec2pt.Vector, Amplitude=Slider(75, range=0..100))
move = Move(Geometry=pt, Motion=amp)  # -> Geometry, Transform
flip = FlipMatrix(Data=move.Geometry)
bang = ExplodeTree(Data=flip)  # -> Branch0, Branch1, Branch2
srf4pt = _4PointSurface(CornerA=bang.Branch0, CornerB=bang.Branch1, CornerC=bang.Branch2)
area = Area(Geometry=srf4pt)  # -> Area, Centroid
scale = Scale(Geometry=srf4pt, Center=area.Centroid, Factor=Slider(0.85, range=0..1))  # -> Geometry, Transform
